# Grasshopper definition ICN_Automater.gh (Grasshopper 1.0.7)
# plug-ins: Archsim

panel = Panel("C:\Users\Junho Kim-Lee\Documents\ICN\Ithaca-Carbon-Neutral\Automater_Project\src\config_maker\configs")
# Results Path
# Input full path of your target output directory. The directory must be empty before running.
panel_2 = Panel("C:\Users\Junho Kim-Lee\Documents\ICN\Ithaca-Carbon-Neutral\Automater_Project\results")
# Config Path
# Input the full path of the directory containing your config files.
# All construction config files must follow the nomenclature:
# 'cons_[n].txt' where [n] is an integer greater than or equal to 0. (ex: 'cons_1.txt').
# All window config files must follow the above nomenclature except replacing 'cons' with 'win'. (ex: 'win_1.txt').
panel_3 = Panel("Tester_model")
panel_4 = Panel("Input model name")
panel_5 = Panel("On/Off Switch")
timer = Timer(TimerInterval=1000, Target=python)
python = GhPythonScript(x=panel_3, y=panel, z=panel_2)  # -> out, a, b, c, d, e
# ---------- python: Python ----------
__author__ = "Junho Kim-Lee"
__version__ = "2020.10.05"

import rhinoscriptsyntax as rs
import os

# inputs
e = x
config_path = y.encode('unicode_escape')
results_path = z.encode('unicode_escape')

# count up current results in output dir
config_count = sum(len(files) for _, _, files in os.walk(config_path))
config_count = int(config_count/2)
results_count = 0
for path, _, _ in os.walk(results_path):
    if path != results_path:
        s = sum(len(files) for _, _, files in os.walk(path))
        if s > 2:
            results_count += 1


d = False

# run sim
if results_count < config_count:
    i = results_count +1
    cons = r'\cons_'+str(i)+'.txt'
    win = r'\window_'+str(i)+'.txt'
    output = r'\use_case_'+str(i)
    with open(config_path + cons, 'r') as file:
        a = file.read().replace('\n', '')     
    with open(config_path + win, 'r') as file:
        b = file.read().replace('\n', '')
    c = results_path + output
    d = True
# ---------- end python ----------
# Set this brep to be your construction
brep = Brep(<brep referenced from the Rhino model>)
# Set this brep to be your windows
brep_2 = Brep([<brep referenced from the Rhino model> x4])
zone = ThermalZone(
    ThermalZoneGeometry=brep,
    Name="construction",
    SettingsAsFormatedString=python.a,
    Library="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",
    Settings="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")  # -> ThermalZones, SettingsAsFormatedString
window = Window(
    WindowGeometry=brep_2,
    SettingsAsFormatedString=python.b,
    Library="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",
    Settings="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")  # -> Window, SettingsAsFormatedString
networker = ZoneConnectivityNetwork(ThermalZoneCollection=zone.ThermalZones, Windows=window.Window)
python_2 = GhPythonScript(x=python.d, y=Toggle(False))  # -> out, a
# ---------- python_2: Python ----------
__author__ = "Junho Kim-Lee"
__version__ = "2020.10.16"

import rhinoscriptsyntax as rs

switch = x
io = y

if io == True:
    a = switch
else:
    a = False
# ---------- end python_2 ----------
# Alter your energy simulation outputs here and set the weather to Cornell's location
run_e = SimulationEngine(
    ThermalModel=networker,
    ProjectName=python.e,
    WorkingDirectory=python.c,
    WeatherFile="USA_NY_Cornell.Univ.Teaching.Dairy.Barn.749003_TMYx.2004-2018",
    StartsTheSimulation=python_2.a,
    settings="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")  # -> ThermalModel, SettingsAsFormatedString
