# Grasshopper definition tester1.gh (Grasshopper 1.0.7)
# plug-ins: Archsim

panel = Panel("C:\Users\Junho Kim-Lee\Documents\ICN\Ithaca-Carbon-Neutral\Automater_Project\results")
panel_2 = Panel("C:\Users\Junho Kim-Lee\Documents\ICN\Ithaca-Carbon-Neutral\Automater_Project\configs")
zone_settings = ZoneSettings(
    Name="noName",
    ZoneConstructions="Default",
    ZoneLoads="Residential",
    ZoneConditioning="Residential",
    ZoneVentilation="Off",
    ZoneHotWater="Off")
panel_3 = Panel("Results Path")
panel_4 = Panel("Config Path")
panel_5 = Panel("Model Name")
python = GhPythonScript(x=zone_settings, y=Button())  # -> out, a, b
# ---------- python: Python ----------
__author__ = "Junho Kim-Lee"
__version__ = "2020.10.05"

import rhinoscriptsyntax as rs
import System.Guid as Guid
import Rhino

#print(dir(x))
for attr in dir(x):
    if callable(getattr(x,attr)):
        #print(attr+'()')
        pass
    else:
        print(attr)
print(type(x.Category))
print(type(x.Comment))
print(type(x.Conditioning))
print(type(x.DataSource))
print(type(x.DomHotWater))
print(type(x.FloorTiltAngle))
print(type(x.Loads))
print(type(x.Materials))
print(type(x.Name))
print(type(x.RoofTiltAngle))
print(type(x.Ventilation))
print(type(x.ZoneMultiplier))

#print(x.__init__)

print(type(x))
#print(x)
# ---------- end python ----------
window_settings = WindowSettings(
    Name="noName",
    WindowType="External",
    WindowConstruction="defaultGlazing",
    Shading="None",
    ShadeAvailibilitySchedule="AllOn",
    ShadeSetPoint=100,
    ShadeTransmittance=0.5,
    ZoneMixingOnOff=False,
    FlowRate=0.1,
    DeltaT=0.1,
    MixingAvailibilitySchedule="AllOn",
    OperableArea=0.8)
panel_6 = Panel(zone_settings)
panel_7 = Panel("On/Off Switch")
panel_8 = Panel(python.out)
timer = Timer(TimerInterval=1000, Target=python_2)
python_2 = GhPythonScript(x="Tester_model", y=panel_2, z=panel)  # -> out, a, b, c, d, e
# ---------- python_2: Python ----------
__author__ = "Junho Kim-Lee"
__version__ = "2020.10.05"

import rhinoscriptsyntax as rs
import os

e = x
config_path = y.encode('unicode_escape')
results_path = z.encode('unicode_escape')

config_count = sum(len(files) for _, _, files in os.walk(config_path))
config_count = int(config_count/2)
results_count = 0
for path, _, _ in os.walk(results_path):
    if path != results_path:
        s = sum(len(files) for _, _, files in os.walk(path))
        if s > 2:
            results_count += 1


d = False

if results_count < config_count:
    i = results_count +1
    cons = r'\cons_'+str(i)+'.txt'
    win = r'\window_'+str(i)+'.txt'
    output = r'\use_case_'+str(i)
    with open(config_path + cons, 'r') as file:
        a = file.read().replace('\n', '')     
    with open(config_path + win, 'r') as file:
        b = file.read().replace('\n', '')
    c = results_path + output
    d = True
# ---------- end python_2 ----------
panel_9 = Panel(window_settings)
# Set this brep to be your construction
brep = Brep(<brep referenced from the Rhino model>)
# Set this brep to be your windows
brep_2 = Brep([<brep referenced from the Rhino model> x4])
zone = ThermalZone(
    ThermalZoneGeometry=brep,
    Name="construction",
    SettingsAsFormatedString=python_2.a,
    Library="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",
    Settings="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")  # -> ThermalZones, SettingsAsFormatedString
window = Window(
    WindowGeometry=brep_2,
    SettingsAsFormatedString=python_2.b,
    Library="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",
    Settings="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")  # -> Window, SettingsAsFormatedString
networker = ZoneConnectivityNetwork(ThermalZoneCollection=zone.ThermalZones, Windows=window.Window)
python_3 = GhPythonScript(x=python_2.d, y=Toggle(False))  # -> out, a
# ---------- python_3: Python ----------
__author__ = "Junho Kim-Lee"
__version__ = "2020.10.16"

import rhinoscriptsyntax as rs

switch = x
io = y

if io == True:
    a = switch
else:
    a = False
# ---------- end python_3 ----------
# Alter your energy simulation outputs here and set the weather to Cornell's location
run_e = SimulationEngine(
    ThermalModel=networker,
    ProjectName=python_2.e,
    WorkingDirectory=python_2.c,
    WeatherFile="USA_NY_Cornell.Univ.Teaching.Dairy.Barn.749003_TMYx.2004-2018",
    StartsTheSimulation=python_3.a,
    settings="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")  # -> ThermalModel, SettingsAsFormatedString
